# Grasshopper definition RoadDetailBuilder.gh (Grasshopper 1.0.8)

py3 = Python3Script(
    script=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,
    Run=Toggle(True),
    Bake=Toggle(False),
    lane_width=Slider(3, range=2.5..4),
    line_width=Slider(0.1, range=0.1..0.3))  # -> out, centerlines, lanelines, edgelines; inputs Run: Boolean, Bake: Boolean, lane_width: Double, line_width: Double; unedited script template
geo = Geometry(py3.centerlines)
panel = Panel(py3.out)
